# Grasshopper definition gHowl_UDP_send+receive.ghx (Grasshopper 0.9.75)
# plug-ins: Anemone, gHowl

dom = ConstructDomain(DomainStart="20\t", DomainEnd="100\t")
port = Panel("7001")
# Import string from Processing
udp_owl = UDPReceiver(Port=port, Pattern=0)  # -> Info, Data
panel = Panel(udp_owl.Data)
# Parse string into small text chunks
split = StringSplit(String=udp_owl.Data, Separators=";")
loop_start = LoopStart(Repeat=0, Data_0=split)  # -> port, Counter, Data_0
lng = ListLength(List=loop_start.Data_0)
division = Division(A=lng, B="4")
random = Random(Range=dom, Number=division, Seed=2, Integers=True)
panel_2 = Panel(random)
ins = InsertItems(List=loop_start.Data_0, Item=panel_2, Indices=expr("x+5", "5"), Wrap=True)
panel_3 = Panel(ins)
partition = PartitionList(List=panel_3, Size="5")
panel_4 = Panel(loop_start.Data_0)
# want random heights - but input into Box.z doesn't get called correctly.
# thinking the random values will need to be generated and then inserted?
panel_5 = Panel(partition)
# Split into groups of 4 numbers
# that define the geometry
partition_2 = PartitionList(List=loop_start.Data_0, Size="4")
panel_6 = Panel(partition_2)
# Split into groups of 2 numbers
# that define the origin and size & draw box
loop_start_2 = LoopStart(Repeat=0, Data_0=partition_2)  # -> port, Counter, Data_0
# for rect (x,y,w,h)
# where x,y is origin
# w,h is size
split_2 = SplitList(List=loop_start_2.Data_0, Index=2)  # -> ListA, ListB
split_3 = SplitList(List=split_2.ListA, Index=1)  # -> ListA, ListB
pt = ConstructPoint(XCoordinate=split_3.ListA, YCoordinate=split_3.ListB, ZCoordinate=0)
split_1 = SplitList(List=split_2.ListB, Index=1)  # -> ListA, ListB
# try either domain box
# or center box!
box = DomainBox(Base=pt, X=split_1.ListA, Y=split_1.ListB, Z=Domain(0, 50))
loop_end = LoopEnd(port=loop_start_2.port, Exit=False, Data_0=box, pausedState=False, state="Last & Record")
loop_end_2 = LoopEnd(port=loop_start.port, Exit=False, Data_0=loop_end, pausedState=False, state="Last & Record")
panel_7 = Panel(loop_end_2)
